# Grasshopper definition read_point_lists(1).gh (Grasshopper 1.0.7)
# plug-ins: Kangaroo2 Components

panel = Panel("/Users/laszlomangliar/Documents/GitHub/VoxelBuilderDemo/scr/data/point_lists")
python = GhPythonScript(in_path=panel, i=Slider(0, range=0..10))  # -> out, data; inputs i: Int32
# ---------- python: Python ----------
import os
from compas.colors import Color
from compas.geometry import Pointcloud
import json
from ghpythonlib.treehelpers import list_to_tree

def get_newest_file_in_folder(folder_path):
    try:
        # Get a list of files in the folder
        files = [os.path.join(folder_path, filename) for filename in os.listdir(folder_path)]
        # print(files)
        # Sort the files by change time (modification time) in descending order
        # files.sort(key=lambda x: os.path.getmtime(x), reverse=True)
        print('files in folder:')
        print(files)
        # Return the newest file
        if files:
            return files[0]
        else:
            print("Folder is empty.")
            return None
    except Exception as e:
        print(e)
        return None

def get_nth_newest_file_in_folder(folder_path, n):
    try:
        # Get a list of files in the folder
        files = [os.path.join(folder_path, filename) for filename in os.listdir(folder_path)]

        # Sort the files by change time (modification time) in descending order
        files.sort(key=lambda x: os.path.getmtime(x), reverse=True)

        # Return the newest file
        if files:
            return files[min(n, len(files))]
        else:
            print("Folder is empty.")
            return None
    except Exception as e:
        print(e)
        return None

# params
Nth = i
show = True
radius = 0.25
#folder_path = os.path.join(in_path)

file = get_nth_newest_file_in_folder(in_path, Nth)
print(file)

try:
    # read
    with open(file, 'r') as file:
        data = json.load(file)
except Exception as e:
    print(e)
"""
try: 
    os.path.isfile(file) # open file
    ptcloud = Pointcloud.from_json(file)
    # ptcloud = Pointcloud.from_jsonstring(file)
except Exception as e:
    print(e)"""
    
data = list_to_tree(data)
# ---------- end python ----------
panel_2 = Panel(python.out)

dam = DataDam(DataA=python.data, BufferDelay=10000000, BufferMode=0)
flip = FlipMatrix(Data=dam)
item = ListItem(List=dam, Index=0, Wrap=True)  # -> Item, Item1, Item2
pt = ConstructPoint(XCoordinate=item.Item, YCoordinate=item.Item1, ZCoordinate=item.Item2)
index = ItemIndex(List=flatten(pt), Item=pt)
cull_i = CullIndex(List=flatten(pt), Indices=index, Wrap=True)
cps = ClosestPoints(Point=pt, Cloud=cull_i, Count=Slider(9, range=0..10))  # -> ClosestPoint, CPIndex, Distance
ln = Line(StartPoint=pt, EndPoint=cps.ClosestPoint)  # -> flatten(Line)
dupln = RemoveDuplicateLines(Lines=ln, Tolerance=0.01)
