# Grasshopper definition read_point_lists3 2.gh (Grasshopper 1.0.7)
# plug-ins: Kangaroo2 Components

panel = Panel("/Users/laszlomangliar/Documents/GitHub/VoxelBuilderDemo/scr/data/point_lists")
python = GhPythonScript(in_path=panel, i=Slider(0, range=0..10), reset=Button())  # -> out, data; inputs i: Int32
# ---------- python: Python ----------
import os
from compas.colors import Color
from compas.geometry import Pointcloud
import json
from ghpythonlib.treehelpers import list_to_tree

def get_newest_file_in_folder(folder_path):
    try:
        # Get a list of files in the folder
        files = [os.path.join(folder_path, filename) for filename in os.listdir(folder_path)]
        # print(files)
        # Sort the files by change time (modification time) in descending order
        # files.sort(key=lambda x: os.path.getmtime(x), reverse=True)
        print('files in folder:')
        print(files)
        # Return the newest file
        if files:
            return files[0]
        else:
            print("Folder is empty.")
            return None
    except Exception as e:
        print(e)
        return None

def get_nth_newest_file_in_folder(folder_path, n):
    try:
        # Get a list of files in the folder
        files = [os.path.join(folder_path, filename) for filename in os.listdir(folder_path)]

        # Sort the files by change time (modification time) in descending order
        files.sort(key=lambda x: os.path.getmtime(x), reverse=True)

        # Return the newest file
        if files:
            return files[min(n, len(files))]
        else:
            print("Folder is empty.")
            return None
    except Exception as e:
        print(e)
        return None

# params
Nth = i
show = True
radius = 0.25
#folder_path = os.path.join(in_path)
if reset:
    pass

file = get_nth_newest_file_in_folder(in_path, Nth)
print(file)

try:
    # read
    with open(file, 'r') as file:
        data = json.load(file)
except Exception as e:
    print(e)
"""
try: 
    os.path.isfile(file) # open file
    ptcloud = Pointcloud.from_json(file)
    # ptcloud = Pointcloud.from_jsonstring(file)
except Exception as e:
    print(e)"""
    
data = list_to_tree(data)
# ---------- end python ----------
panel_2 = Panel(python.out)

lng = ListLength(List=flatten(python.data))
panel_3 = Panel(lng)

dam = DataDam(DataA=python.data, BufferDelay=10000000, BufferMode=2)
item = ListItem(List=dam, Index=0, Wrap=True)  # -> Item, Item1, Item2
pt = ConstructPoint(XCoordinate=item.Item, YCoordinate=item.Item1, ZCoordinate=item.Item2)

equals = Equality(FirstNumber=item.Item2, SecondNumber="0")  # -> Equality, Inequality
cull = CullPattern(List=pt, CullPattern=equals.Inequality)
cull_2 = CullPattern(List=pt, CullPattern=equals.Equality)

flatten = FlattenTree(Tree=cull, Path="{0}")
group = Group(Objects=flatten)
rec = DataRecorder(group, DataLimit=-10, RecordData=False)

number_slider = Slider(0.5, range=0..1)
number_slider_2 = Slider(1, range=0..1)
box = CenterBox(Base=PlaneXY(0, 0, 0), X=number_slider, Y=number_slider, Z=number_slider)
move = Move(Motion=cull)  # -> Geometry, Transform
mbox = MeshBox(Base=box, XCount=number_slider_2, YCount=number_slider_2, ZCount=number_slider_2)
transform = Transform(Geometry=mbox, Transform=move.Transform)
preview = CustomPreview(
    Geometry=transform,
    Material={diffuse=RGB(228, 178, 227), emission=RGB(68, 53, 68), shine=0.5, specular=RGB(255, 254, 254), transparency=0})

index = ItemIndex(List=flatten(cull), Item=cull)  # disabled
cull_i = CullIndex(List=flatten(cull), Indices=index, Wrap=True)  # disabled
pt_2 = Point(cull_i)  # disabled
pt_3 = Point(cull)  # disabled

move_2 = Move(Motion=cull_2)  # -> Geometry, Transform
transform_2 = Transform(Geometry=mbox, Transform=move_2.Transform)

number_slider_3 = Slider(4, range=0..10)  # disabled
pt_4 = Point(pt_2)  # disabled
pt_5 = Point(pt_3)  # disabled
cps = ClosestPoints(Point=pt_5, Cloud=pt_4, Count=number_slider_3)  # -> ClosestPoint, CPIndex, Distance; disabled
conmesh = ConstructMesh(Vertices=cps.ClosestPoint, Faces={A=0, B=1, C=2, D=3})  # disabled

preview_2 = CustomPreview(Geometry=transform_2, Material=ColourSwatch(SwatchColor=RGB(255, 254, 254)))

number_slider_4 = Slider(6, range=0..10)  # disabled
pt_6 = Point(pt_2)  # disabled
pt_7 = Point(pt_3)  # disabled
cps_2 = ClosestPoints(Point=pt_7, Cloud=pt_6, Count=number_slider_4)  # -> ClosestPoint, CPIndex, Distance; disabled
ln = Line(StartPoint=pt_7, EndPoint=cps_2.ClosestPoint)  # -> flatten(Line); disabled
dupln = RemoveDuplicateLines(Lines=ln, Tolerance=0.01)  # disabled
