# Grasshopper definition read_point_lists4.gh (Grasshopper 1.0.7)
# plug-ins: Kangaroo2 Components

panel = Panel("/Users/laszlomangliar/Documents/GitHub/VoxelBuilderDemo/scr/data/point_lists")
button = Button()

panel_2 = Panel("/Users/laszlomangliar/Documents/GitHub/VoxelBuilderDemo/scr/data/point_lists_sorted")
number_slider = Slider(0, range=0..10)
python = GhPythonScript(in_path=panel, i=number_slider, reset=button)  # -> out, pts; inputs i: Int32
# ---------- python: Python ----------
import os
from compas.colors import Color
from compas.geometry import Pointcloud
import json
from ghpythonlib.treehelpers import list_to_tree

def get_newest_file_in_folder(folder_path):
    try:
        # Get a list of files in the folder
        files = [os.path.join(folder_path, filename) for filename in os.listdir(folder_path)]
        # print(files)
        # Sort the files by change time (modification time) in descending order
        # files.sort(key=lambda x: os.path.getmtime(x), reverse=True)
        print('files in folder:')
        print(files)
        # Return the newest file
        if files:
            return files[0]
        else:
            print("Folder is empty.")
            return None
    except Exception as e:
        print(e)
        return None

def get_nth_newest_file_in_folder(folder_path, n):
    try:
        # Get a list of files in the folder
        files = [os.path.join(folder_path, filename) for filename in os.listdir(folder_path)]

        # Sort the files by change time (modification time) in descending order
        files.sort(key=lambda x: os.path.getmtime(x), reverse=True)

        # Return the newest file
        if files:
            return files[min(n, len(files))]
        else:
            print("Folder is empty.")
            return None
    except Exception as e:
        print(e)
        return None

# params
Nth = i
show = True
radius = 0.25
#folder_path = os.path.join(in_path)
if reset:
    pass

file = get_nth_newest_file_in_folder(in_path, Nth)
print(file)

try:
    # read
    with open(file, 'r') as file:
        data = json.load(file)
except Exception as e:
    print(e)
"""
try: 
    os.path.isfile(file) # open file
    ptcloud = Pointcloud.from_json(file)
    # ptcloud = Pointcloud.from_jsonstring(file)
except Exception as e:
    print(e)"""
pts = list_to_tree(data)
# ---------- end python ----------
panel_3 = Panel(python.out)

python_2 = GhPythonScript(in_path=panel_2, i=number_slider, reset=button)  # -> out, values, pts; inputs i: Int32; disabled
# ---------- python_2: Python ----------
import os
from compas.colors import Color
from compas.geometry import Pointcloud
import json
from ghpythonlib.treehelpers import list_to_tree

def get_newest_file_in_folder(folder_path):
    try:
        # Get a list of files in the folder
        files = [os.path.join(folder_path, filename) for filename in os.listdir(folder_path)]
        # print(files)
        # Sort the files by change time (modification time) in descending order
        # files.sort(key=lambda x: os.path.getmtime(x), reverse=True)
        print('files in folder:')
        print(files)
        # Return the newest file
        if files:
            return files[0]
        else:
            print("Folder is empty.")
            return None
    except Exception as e:
        print(e)
        return None

def get_nth_newest_file_in_folder(folder_path, n):
    try:
        # Get a list of files in the folder
        files = [os.path.join(folder_path, filename) for filename in os.listdir(folder_path)]

        # Sort the files by change time (modification time) in descending order
        files.sort(key=lambda x: os.path.getmtime(x), reverse=True)

        # Return the newest file
        if files:
            return files[min(n, len(files))]
        else:
            print("Folder is empty.")
            return None
    except Exception as e:
        print(e)
        return None

# params
Nth = i
show = True
radius = 0.25
#folder_path = os.path.join(in_path)
if reset:
    pass

file = get_nth_newest_file_in_folder(in_path, Nth)
print(file)

try:
    # read
    with open(file, 'r') as file:
        data = json.load(file)
except Exception as e:
    print(e)
"""
try: 
    os.path.isfile(file) # open file
    ptcloud = Pointcloud.from_json(file)
    # ptcloud = Pointcloud.from_jsonstring(file)
except Exception as e:
    print(e)"""
a = data['a']
b = data['b']
pts = list_to_tree(a)
values = list_to_tree(b)
# ---------- end python_2 ----------
lng = ListLength(List=flatten(python.pts))
panel_4 = Panel(lng)

dam = DataDam(DataA=python.pts, BufferDelay=10000000, BufferMode=2)
item = ListItem(List=dam, Index=0, Wrap=True)  # -> Item, Item1, Item2
pt = ConstructPoint(XCoordinate=item.Item, YCoordinate=item.Item1, ZCoordinate=item.Item2)

equals = Equality(FirstNumber=item.Item2, SecondNumber="0")  # -> Equality, Inequality
cull = CullPattern(List=pt, CullPattern=equals.Inequality)
cull_2 = CullPattern(List=pt, CullPattern=equals.Equality)

flatten = FlattenTree(Tree=cull, Path="{0}")
group = Group(Objects=flatten)
rec = DataRecorder(group, DataLimit=-10, RecordData=False)

number_slider_2 = Slider(0.5, range=0..1)
number_slider_3 = Slider(1, range=0..1)
box = CenterBox(Base=PlaneXY(0, 0, 0), X=number_slider_2, Y=number_slider_2, Z=number_slider_2)
move = Move(Motion=cull)  # -> Geometry, Transform
mbox = MeshBox(Base=box, XCount=number_slider_3, YCount=number_slider_3, ZCount=number_slider_3)
transform = Transform(Geometry=mbox, Transform=move.Transform)
preview = CustomPreview(
    Geometry=transform,
    Material={diffuse=RGB(228, 178, 227), emission=RGB(68, 53, 68), shine=0.5, specular=RGB(255, 254, 254), transparency=0})

index = ItemIndex(List=flatten(cull), Item=cull)  # disabled
cull_i = CullIndex(List=flatten(cull), Indices=index, Wrap=True)  # disabled
pt_2 = Point(cull_i)  # disabled
pt_3 = Point(cull)  # disabled

flatten_2 = FlattenTree(Tree=move.Transform, Path="{0}")
python_3 = GhPythonScript(x=flatten(flatten_2), y=Slider(1, range=0..1))  # -> out, a; inputs x: list
# ---------- python_3: Python ----------
"""normalize n - return x * n [int]
"""
l = len(x)

a = int(l*y)
# ---------- end python_3 ----------
move_2 = Move(Motion=cull_2)  # -> Geometry, Transform
split = SplitList(List=flatten_2, Index=python_3.a)  # -> ListA, ListB
panel_5 = Panel(python_3.a)

number_slider_4 = Slider(4, range=0..10)  # disabled
pt_4 = Point(pt_2)  # disabled
pt_5 = Point(pt_3)  # disabled
cps = ClosestPoints(Point=pt_5, Cloud=pt_4, Count=number_slider_4)  # -> ClosestPoint, CPIndex, Distance; disabled
conmesh = ConstructMesh(Vertices=cps.ClosestPoint, Faces={A=0, B=1, C=2, D=3})  # disabled

transform_2 = Transform(Geometry=mbox, Transform=move_2.Transform)
preview_2 = CustomPreview(Geometry=transform_2, Material=ColourSwatch(SwatchColor=RGB(255, 254, 254)))

number_slider_5 = Slider(6, range=0..10)  # disabled
pt_6 = Point(pt_2)  # disabled
pt_7 = Point(pt_3)  # disabled
cps_2 = ClosestPoints(Point=pt_7, Cloud=pt_6, Count=number_slider_5)  # -> ClosestPoint, CPIndex, Distance; disabled
ln = Line(StartPoint=pt_7, EndPoint=cps_2.ClosestPoint)  # -> flatten(Line); disabled
dupln = RemoveDuplicateLines(Lines=ln, Tolerance=0.01)  # disabled

number_slider_6 = Slider(0.5, range=0..1)
number_slider_7 = Slider(1, range=0..1)
box_2 = CenterBox(Base=PlaneXY(0, 0, 0), X=number_slider_6, Y=number_slider_6, Z=number_slider_6)
mbox_2 = MeshBox(Base=box_2, XCount=number_slider_7, YCount=number_slider_7, ZCount=number_slider_7)
