# Grasshopper definition read_point_lists4_volumetric.gh (Grasshopper 1.0.7)
# plug-ins: Kangaroo2 Components, Axolotl Info

t = Slider(1, range=0..1)
show_floor = BooleanToggle(True)
show_as_anim = BooleanToggle(True)

reload = Button()

panel = Panel("/Users/laszlomangliar/Documents/GitHub/VoxelBuilderDemo/data/json/points_values")
python = GhPythonScript(in_path=panel, i=Slider(0, range=0..10), run=Toggle(True), reset=reload)  # -> out, values, pt_list; inputs i: Int32
# ---------- python: Python ----------
import os
from compas.colors import Color
from compas.geometry import Pointcloud
import json
from ghpythonlib.treehelpers import list_to_tree

def get_newest_file_in_folder(folder_path):
    try:
        # Get a list of files in the folder
        files = [os.path.join(folder_path, filename) for filename in os.listdir(folder_path)]
        # print(files)
        # Sort the files by change time (modification time) in descending order
        # files.sort(key=lambda x: os.path.getmtime(x), reverse=True)
        print('files in folder:')
        print(files)
        # Return the newest file
        if files:
            return files[0]
        else:
            print("Folder is empty.")
            return None
    except Exception as e:
        print(e)
        return None

def get_nth_newest_file_in_folder(folder_path, n):
    try:
        # Get a list of files in the folder
        files = [os.path.join(folder_path, filename) for filename in os.listdir(folder_path)]

        # Sort the files by change time (modification time) in descending order
        files.sort(key=lambda x: os.path.getmtime(x), reverse=True)

        # Return the newest file
        if files:
            return files[min(n, len(files))]
        else:
            print("Folder is empty.")
            return None
    except Exception as e:
        print(e)
        return None
if reset:
    pass

# params
Nth = i

if run:

    file = get_nth_newest_file_in_folder(in_path, Nth)
    print(file)

    try:
        # read
        with open(file, 'r') as file:
            data = json.load(file)
    except Exception as e:
        print(e)
        data = None
   
    try:
        a = data['pt_list']
        b = data['values']
    except:
        a = data
        b = None
    pt_list = list_to_tree(a)
    values = list_to_tree(b)
# ---------- end python ----------
panel_2 = Panel(python.values)
panel_3 = Panel(python.pt_list)
lng = ListLength(List=flatten(python.pt_list))
panel_4 = Panel(python.out)
panel_5 = Panel(lng)
dam = DataDam(DataA=python.pt_list, BufferDelay=10000000, BufferMode=0)

msphereex = MeshSphereEx(Base=PlaneXY(0, 0, 0), Radius=Slider(0.8, range=0..1), Count=Slider(3, range=0..10))
scale_nu = ScaleNU(Geometry=msphereex, Plane=PlaneXY(0, 0, 0), ScaleX=1, ScaleY=1, ScaleZ=Slider(0.8, range=0..1))  # -> Geometry, Transform

stretch_z = Slider(1.8, range=0..10)
number_slider = Slider(1, range=0..1)
division = Division(A=stretch_z, B=2)

# ---- group: voxel_box
number_slider_2 = Slider(0.5, range=0..1)
number_slider_3 = Slider(1, range=0..1)
box = CenterBox(Base=PlaneXY(0, 0, 0), X=number_slider_2, Y=number_slider_2, Z=division)
mbox = MeshBox(Base=box, XCount=number_slider_3, YCount=number_slider_3, ZCount=number_slider_3)

# ----
box_2 = Box(
    DimensionX=number_slider,
    DimensionY=number_slider,
    DimensionZ=stretch_z,
    Radius=Slider(0.3, range=0..1),
    Plane=PlaneXY(0, 0, 0))
number_slider_4 = Slider(19, range=0..100)
number_slider_5 = Slider(17, range=0..179)
swatch = ColourSwatch(SwatchColor=RGB(217, 202, 156))
box_3 = Box(DimensionX=number_slider_4, DimensionY=number_slider_4, DimensionZ=number_slider_4, Radius=0, Plane="25,25,4")

item = ListItem(List=dam, Index=0, Wrap=True)  # -> Item, Item1, Item2

multiplication = Multiplication(A=item.Item2, B=stretch_z)
panel_6 = Panel(item.Item2)

pt = ConstructPoint(XCoordinate=item.Item, YCoordinate=item.Item1, ZCoordinate=multiplication)

# ---- group: separate floor
equals = Equality(FirstNumber=item.Item2, SecondNumber="0")  # -> Equality, Inequality
cull = CullPattern(List=pt, CullPattern=equals.Inequality)
cull_2 = CullPattern(List=pt, CullPattern=equals.Equality)

# ----
move = Move(Motion=cull_2)  # -> Geometry, Transform
move_2 = Move(Motion=cull)  # -> Geometry, Transform

# ---- group: make clay color
cull_3 = CullPattern(List=panel_2, CullPattern=flatten(equals.Inequality))
bnd = Bounds(Numbers=cull_3)
dom = ConstructDomain(DomainStart=Slider(0.2, range=0..1), DomainEnd=Slider(0.8, range=0..1))
remap = RemapNumbers(Value=cull_3, Source=bnd, Target=dom)  # -> Mapped, Clipped
hsv = ColourHSV(Alpha=1, Hue=Slider(0.117, range=0..1), Saturation=remap.Mapped, Value=Slider(0.59, range=0..1))

# ----
orient = Orient(DistanceObject=box_2, Plane=cull)

# ---- group: ground
transform = Transform(Geometry=mbox, Transform=move.Transform)
cull_4 = CullPattern(List=transform, CullPattern=show_floor)
preview = CustomPreview(Geometry=cull_4, Material=ColourSwatch(SwatchColor=RGB(145, 140, 140)))

# ----
smoothunionlist = SmoothUnionList(DistanceObjects=flatten(orient), SmoothingFactor=5)
boolean_intersect = BooleanIntersect(DistanceObjectS=box_3, DistanceObject=smoothunionlist)  # -> flatten(DistanceObject)

index = ItemIndex(List=flatten(cull), Item=cull)  # disabled
cull_i = CullIndex(List=flatten(cull), Indices=index, Wrap=True)  # disabled
pt_2 = Point(cull_i)  # disabled
pt_3 = Point(cull)  # disabled

isosurface_octree = IsosurfaceOctree(
    Origin="25,25,4",
    WorldSize=Slider(20, range=0..100),
    Isovalue=0,
    Subdivisions=Slider(3, range=0..10),
    DistanceObject=boolean_intersect)
unim = UnifyMesh(Mesh=isosurface_octree)  # -> Result, Count

number_slider_6 = Slider(4, range=0..10)  # disabled
pt_4 = Point(pt_2)  # disabled
pt_5 = Point(pt_3)  # disabled
cps = ClosestPoints(Point=pt_5, Cloud=pt_4, Count=number_slider_6)  # -> ClosestPoint, CPIndex, Distance; disabled
conmesh = ConstructMesh(Vertices=cps.ClosestPoint, Faces={A=0, B=1, C=2, D=3})  # disabled

number_slider_7 = Slider(6, range=0..10)  # disabled
pt_6 = Point(pt_2)  # disabled
pt_7 = Point(pt_3)  # disabled
cps_2 = ClosestPoints(Point=pt_7, Cloud=pt_6, Count=number_slider_7)  # -> ClosestPoint, CPIndex, Distance; disabled
ln = Line(StartPoint=pt_7, EndPoint=cps_2.ClosestPoint)  # -> flatten(Line); disabled
dupln = RemoveDuplicateLines(Lines=ln, Tolerance=0.01)  # disabled

# ---- group: make clay color
cull_5 = CullPattern(List=panel_2, CullPattern=flatten(equals.Inequality))
dom_2 = ConstructDomain(DomainStart=Slider(0.2, range=0..1), DomainEnd=Slider(0.8, range=0..1))

# ---- group: split list
dispatch = Dispatch(List=move_2.Transform, DispatchPattern=invert(show_as_anim))  # -> ListA, ListB
flatten = FlattenTree(Tree=dispatch.ListB, Path="{0}")
python_2 = GhPythonScript(x=flatten(flatten), y=t)  # -> out, a; inputs x: list
# ---------- python_2: Python ----------
"""normalize n - return x * n [int]
"""
l = len(x)

a = int(l*y)
# ---------- end python_2 ----------
swatch_2 = ColourSwatch(SwatchColor=RGB(161, 145, 100))
split = SplitList(List=flatten, Index=python_2.a)  # -> ListA, ListB
panel_7 = Panel(python_2.a)
transform_2 = Transform(Geometry=mbox, Transform=split.ListA)

# ---- group: make clay color (continued)
split_2 = SplitList(List=cull_5, Index=python_2.a)  # -> ListA, ListB
bnd_2 = Bounds(Numbers=split_2.ListA)
remap_2 = RemapNumbers(Value=split_2.ListA, Source=bnd_2, Target=dom_2)  # -> Mapped, Clipped
hsv_2 = ColourHSV(Alpha=1, Hue=Slider(0.117, range=0..1), Saturation=remap_2.Mapped, Value=Slider(0.59, range=0..1))

# ---- group: show_built
transform_3 = Transform(Geometry=mbox, Transform=dispatch.ListA)
preview_2 = CustomPreview(Geometry=transform_3, Material=hsv)

# ----
material = CreateMaterial(Diffuse=hsv_2, Specular=RGB(255, 254, 254), Emission=RGB(0, 0, 0), Transparency=0, Shine=Slider(100, range=0..100))

# ---- group: split list (continued)
preview_3 = CustomPreview(Geometry=transform_2, Material=material)

# ----
preview_4 = CustomPreview(Geometry=unim.Result, Material=material)
