# Grasshopper definition test_rhino_view.ghx (Grasshopper 1.0.7)

number_slider = Slider(142, range=0..1000)
box = CenterBox(Base=PlaneXY(0, 0, 0), X="1", Y="1", Z="1")
number_slider_2 = Slider(0.99, range=0..1)
number_slider_3 = Slider(0.9, range=0..1)
cube = Cube(Value=number_slider)
pt = ConstructPoint(XCoordinate=0, YCoordinate=0, ZCoordinate=0)
arrbox = BoxArray(Cell=box, XCount=number_slider, YCount=number_slider, ZCount=number_slider)  # -> Geometry, Transform
multiplication = Multiplication(A=cube, B=Slider(0.999, range=0..1))
reduce = RandomReduce(List=arrbox.Transform, Reduction=multiplication, Seed=1)
transform = Transform(Geometry=pt, Transform=reduce)
random = Random(Range=Domain(0, 1), Number=multiplication, Seed=2)
rgb = ColourRGB(Alpha=255, Red=random, Green=0, Blue=0)
preview = CustomPreview(Material=rgb)
